# Grasshopper definition Hexagonal Shape.gh (Grasshopper 1.0.7)

size_x_direction = GetInteger(Slider(10, range=0..100), AtLeast=1, AtMost=1, Maximum=2147483647, Minimum=-2147483648, TreeAccess=False)
size_y_direction = GetInteger(Slider(10, range=0..100), AtLeast=1, AtMost=1, Maximum=2147483647, Minimum=-2147483648, TreeAccess=False)
get_number = GetNumber(Slider(8, range=0..10), AtLeast=1, AtMost=1, Maximum=1.797693135e+308, Minimum=-1.797693135e+308, TreeAccess=False)
plane = Plane(PlaneXY(0, 0, 0))
hexagonal = Hexagonal(Plane=plane, Size=get_number, ExtentX=size_x_direction, ExtentY=size_y_direction)  # -> simplify(flatten(Cells)), simplify(flatten(Points))
bounding_box = BoundingBox(Content=hexagonal.Cells, Plane=PlaneXY(0, 0, 0), UnionBox=True)  # -> Box, Box_2
deconstruct_brep = DeconstructBrep(Brep=bounding_box.Box)  # -> Faces, Edges, Vertices
explode = Explode(Curve=hexagonal.Cells, Recursive=True)  # -> simplify(Segments), Vertices
populate_2d = Populate2D(Region=deconstruct_brep.Faces, Count=Slider(5, range=0..10), Seed=Slider(172, range=0..1000))  # -> graft(Population)
partition_list = PartitionList(List=explode.Segments, Size="2")
point = Point(hexagonal.Points)
distance = Distance(PointA=populate_2d, PointB=point)  # -> simplify(Distance)
join_curves = JoinCurves(Curves=partition_list, Preserve=False)  # -> simplify(Curves)
graft_tree = GraftTree(Tree=point, IncludeEmptyLists=True, IncludeNullItems=True)  # -> simplify(Tree)
shift_paths = ShiftPaths(Data=join_curves, Offset=-1)
minimum = Minimum(A=distance, B=Slider(132.1, range=0..1000))
extrude_point = ExtrudePoint(Base=shift_paths, Point=graft_tree)
flip_matrix = FlipMatrix(Data=minimum)
area = Area(Geometry=extrude_point)  # -> Area, Centroid
construct_domain = ConstructDomain(DomainStart=Slider(0.15, range=0..1), DomainEnd=Slider(1, range=0..1))
construct_domain_2 = ConstructDomain(DomainStart=Slider(50, range=0..100), DomainEnd=Slider(1, range=0..1))
mass_addition = MassAddition(Input=flip_matrix)  # -> Result, PartialResults
vector_2pt = Vector2Pt(PointA=graft_tree, PointB=area.Centroid, Unitize=False)  # -> Vector, Length
unit_z = UnitZ(Factor=1)
bounds = Bounds(Numbers=flatten(mass_addition.Result))
radians = Radians(Degrees="90")
rotate = Rotate(Vector=vector_2pt.Vector, Axis=unit_z, Angle=radians)
remap_numbers = RemapNumbers(Value=mass_addition.Result, Source=bounds, Target=construct_domain)  # -> Mapped, Clipped
remap_numbers_2 = RemapNumbers(Value=mass_addition.Result, Source=bounds, Target=construct_domain_2)  # -> Mapped, Clipped
remap_numbers_3 = RemapNumbers(Value=mass_addition.Result, Source=bounds, Target=Domain(0, 1))  # -> Mapped, Clipped
construct_plane = ConstructPlane(Origin=area.Centroid, XAxis=vector_2pt.Vector, YAxis=rotate)
unit_z_2 = UnitZ(Factor=remap_numbers_2.Mapped)
scale_nu = ScaleNU(Geometry=extrude_point, Plane=construct_plane, ScaleX=remap_numbers.Mapped, ScaleY=1, ScaleZ=1)  # -> Geometry, Transform
unit_z_3 = UnitZ(Factor=Slider(5, range=0..100))
move = Move(Geometry=scale_nu.Geometry, Motion=unit_z_2)  # -> Geometry, Transform
graft_tree_2 = GraftTree(Tree=move.Geometry, IncludeEmptyLists=True, IncludeNullItems=True)  # -> simplify(Tree)
graft_tree_3 = GraftTree(Tree=extrude_point, IncludeEmptyLists=True, IncludeNullItems=True)  # -> simplify(Tree)
merge = Merge(Data1=graft_tree_3, Data2=graft_tree_2)
gradient = Gradient(LowerLimit=0, UpperLimit=1, Parameter=remap_numbers_3.Mapped, stops=[0.15: RGB(255, 66, 66), 0.85: RGB(87, 0, 16)])
loft = Loft(Curves=merge, Options={Adjust=False, Closed=False, LoftEnds=0, LoftSimp=0, LoftType=0, Rebuild=10, Refit=0.01})
merge_2 = Merge(Data1=merge, Data2=loft)
shift_paths_2 = ShiftPaths(Data=merge_2, Offset=-1)
brep_join = BrepJoin(Breps=shift_paths_2)  # -> Breps, Closed
custom_preview = CustomPreview(Geometry=brep_join.Breps, Shader=gradient)
context_bake = ContextBake(HexagonalShape=brep_join.Breps)
